# Grasshopper definition A-2-2_ConvertToMesh.gh (Grasshopper 0.9.76)
# plug-ins: NumericalArchitectureCompilerForGH, NumericalGeoUtilsForGH

srf = Surface(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)

nsurface_class_for_geomerty_analysis = NSurface(
    S=srf,
    U=Slider(3, range=0..10),
    V=Slider(7, range=0..10),
    NS=1,
    AS=2,
    AF=0.5,
    ES=2,
    EF=0.5,
    RS=2,
    RF=0.5,
    SC=5,
    Tri=True,
    SG=10,
    SM=10)  # -> Surface, UInt, VInt, UCurve, VCurve, LinesNormal, LinesSlope, CurvaturePositive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
mesh = Mesh(nsurface_class_for_geomerty_analysis.Mesh)

brep_to_subdivision_mesh = PassABrepToSubdivisionMeshMeshToBrep(Brep=srf, Subdivision=Slider(5, range=0..10))  # -> Mesh, Point
mesh_2 = Mesh(brep_to_subdivision_mesh.Mesh)
