# Grasshopper definition A-5_Trees.gh (Grasshopper 0.9.76)
# plug-ins: NumericalArchitectureCompilerForGH, NJSEnvironment, NumericalGeoUtilsForGH

data_listener = PassDDataListenerForAssembly()

number_slider = Slider(6, range=0..10)
srf = Surface(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)
nsurface_class_for_geomerty_analysis = NSurface(S=srf, U=number_slider, V=number_slider, NS=1, AS=2, AF=0.5, ES=2, EF=0.5, RS=2, RF=0.5, SC=5, Tri=True, SG=10, SM=10)  # -> Surface, UInt, VInt, UCurve, VCurve, LinesNormal, LinesSlope, CurvaturePositive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
ntree = SimpleTree(
    LocationPts=nsurface_class_for_geomerty_analysis.Point,
    TrunkScale=1,
    BranchMinScale=0.2,
    BranchMaxScale=0.4,
    Angle=55,
    IterationNumber=5,
    NumberOfBranch=5,
    Scale=1,
    SeedNumber=1,
    Template=0)

pt = Point([Point(21.86366067, 3.546918516, 0), Point(19.86366067, 3.546918516, 0), Point(17.86366067, 3.546918516, 0), Point(22.86366067, 3.546918516, 0), Point(22.86366067, 1.546918516, 0), Point(21.86366067, 2.546918516, 0)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])
ngrasscover = GrassCover(LocationPts=pt, Height1=0.3, Height2=0.5, Bend1=10, Template=0)

crv = Curve([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])
g_from_lines = GraphFromLines(LinesForGraph=crv, Valence=Slider(1, range=0..10))  # -> Graph, Nodes, Edges, SelectedNodes, SelectedEdges
n_to_p = GraphNodeToPoint(Nodes=g_from_lines.SelectedNodes)
ntree_2 = SimpleTree(
    LocationPts=n_to_p,
    TrunkScale=1,
    BranchMinScale=0.2,
    BranchMaxScale=0.4,
    Angle=55,
    IterationNumber=5,
    NumberOfBranch=5,
    Scale=1,
    SeedNumber=1,
    Template=0)

# ----
# Land Object
number_slider_2 = Slider(50, range=0..100)
crv_2 = Curve(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)
ncurve_class_for_geomerty_analysis = NCurve(C=crv_2, N=number_slider_2, NS=2, AS=2, AF=0.5, ES=2, EF=0.5, RS=2, RF=0.5)  # -> Curve, Points, Tangent, Normal, Binormal
ntree_3 = SimpleTree(
    LocationPts=ncurve_class_for_geomerty_analysis.Points,
    TrunkScale=1,
    BranchMinScale=0.2,
    BranchMaxScale=0.4,
    Angle=55,
    IterationNumber=5,
    NumberOfBranch=5,
    Scale=1,
    SeedNumber=Slider(5, range=0..10),
    Template=0)

panel = Panel(ncurve_class_for_geomerty_analysis.Points)
panel_2 = Panel(nsurface_class_for_geomerty_analysis.Point)
panel_3 = Panel(pt)
panel_4 = Panel(n_to_p)
