# Grasshopper definition C-7__ConvertToMesh.gh (Grasshopper 0.9.76)
# plug-ins: NumericalArchitectureCompilerForGH, NumericalGeoUtilsForGH

srf = Surface(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)
cluster = Cluster_2(G=srf)
cluster_2 = Cluster(G=srf)

nsurface_class_for_geomerty_analysis = NSurface(
    S=cluster,
    U=Slider(4, range=0..10),
    V=Slider(7, range=0..10),
    NS=1,
    AS=2,
    AF=0.5,
    ES=2,
    EF=0.5,
    RS=2,
    RF=0.5,
    SC=5,
    Tri=True,
    SG=10,
    SM=10)  # -> Surface, UInt, VInt, UCurve, VCurve, LinesNormal, LinesSlope, CurvaturePositive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
mesh = Mesh(nsurface_class_for_geomerty_analysis.Mesh)

brep_to_subdivision_mesh = PassABrepToSubdivisionMeshMeshToBrep(Brep=cluster_2, Subdivision=Slider(10, range=0..10))  # -> Mesh, Point
mesh_2 = Mesh(brep_to_subdivision_mesh.Mesh)

toggle = BooleanToggle(False)

bake_for_cutting = PassCBakeForCutting(Geometry=mesh, LayerName="bake", ExecuteBool=toggle)
bake_for_cutting_2 = PassCBakeForCutting(Geometry=mesh_2, LayerName="bake", ExecuteBool=toggle)

# ==== cluster Cluster
G = ClusterInput()
X = UnitX(Factor=Slider(50, range=0..100))
move = Move(Geometry=G, Motion=X)  # -> Geometry, Transform
G_2 = ClusterOutput(move.Geometry)

# ==== cluster Cluster_2
G = ClusterInput()
X = UnitX(Factor=Slider(100, range=0..100))
move = Move(Geometry=G, Motion=X)  # -> Geometry, Transform
G_2 = ClusterOutput(move.Geometry)
