# Grasshopper definition A-4 Animation.gh (Grasshopper 0.9.76)
# plug-ins: NumericalGeoUtilsForGH

pt = Point(Point(46, 30, 0))
pt_2 = Point(Point(11, 7, 0))
two_dimensional_point_grid_object = NPoint2D(P1=pt, P2=pt_2, U=Slider(6, range=0..30), V=Slider(7, range=0..20), AS=2, AF=0.5, ES=2, EF=0.5, RS=2, RF=0.5)  # -> P, U, V, UC, VC, S, M
pt_3 = Point([Point(41.77832908, 7.578196623, 6.748047482), Point(22.06412819, 15.9781207, 8.276486457)])
pt_4 = Point(Point(16.89252412, 4, 16.80433945))
pt_5 = Point([Point(11, 18.51034432, 0), Point(46, 18.46014171, 0), Point(24.85518647, 30, 0), Point(35.36331447, 5.587891756, 0), Point(46, 7, 0), Point(46, 30, 0), Point(11, 30, 0), Point(11, 7, 0)])
timer = Timer(TimerInterval=20, Target=dynamic_for_pts_grid)
dynamic_for_pts_grid = DPtsGrid(
    P=two_dimensional_point_grid_object.P,
    U=two_dimensional_point_grid_object.U,
    V=two_dimensional_point_grid_object.V,
    SX=True,
    SY=True,
    SZ=True,
    Fix=pt_5,
    Att=[pt_3, pt_4],
    AS=0.9,
    AF=0.8,
    Damp=0.8,
    Gra=0.3,
    Time=-0.35,
    TL=Slider(10, range=0..10),
    Con=Slider(0.42, range=0..1),
    B=Button())  # -> P, S, M, VV, VF, Traj, L, Ci
nsurface_class_for_geomerty_analysis = NSurface(S=dynamic_for_pts_grid.S, U=5, V=5, NS=1, AS=2, AF=0.5, ES=2, EF=0.5, RS=2, RF=0.5, SC=5, Tri=True, SG=10, SM=10)  # -> Surface, UInt, VInt, UCurve, VCurve, LinesNormal, LinesSlope, CurvaturePositive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
line = Line(nsurface_class_for_geomerty_analysis.LinesNormal)
mesh = Mesh(nsurface_class_for_geomerty_analysis.MeanMesh)
line_2 = Line(nsurface_class_for_geomerty_analysis.CurvaturePositive)
line_3 = Line(nsurface_class_for_geomerty_analysis.CurvatureNegative)
crv = Curve(nsurface_class_for_geomerty_analysis.UCurve)
line_4 = Line(nsurface_class_for_geomerty_analysis.LinesSlope)
srf = Surface(nsurface_class_for_geomerty_analysis.Surface)
crv_2 = Curve(nsurface_class_for_geomerty_analysis.VCurve)
